# Grasshopper definition Examples.gh (Grasshopper 0.9.75)
# plug-ins: Google Drive for GH 

image = ImageSampler(
    FilePath="C:\Users\marc\AppData\Local\Microsoft\Windows\Temporary Internet Files\Content.IE5\89XU9L3M\icon-final[1].png",
    Filter="Colour",
    Interpolate=False,
    Umax=1,
    Umin=0,
    Vmax=1,
    Vmin=0,
    Wrap=1)

# ----
# GOOGLE AUTHENTICATOR
# The authenticator component is the first step to any definition with Leafcutter. Your credentials will be stored on your computer until they either expire or you manually clear them with the same component.
authenticate = Button()
clear_credentials = Button()
gauth = GoogleAuthenticator(Authenticate=authenticate, ClearCredentials=clear_credentials)

# ----
# SPREADSHEET LIST
# Spreadsheet list will return a list of all spreadsheet documents on your Google Drive.
# An optional wildcard filter lets you narrow down the list. In the example below, only spreadsheets beginning with "GH_" will be shown.
refresh_list = Button()
refresh_list_2 = Button()
spreadsheetlist = SpreadsheetList(Token=gauth, Filter="GH_*", Refresh=refresh_list)
spreadsheetlist_2 = SpreadsheetList(Token=gauth, Refresh=refresh_list_2)
spreadsheets_beginning_with_gh = Panel(spreadsheetlist)
complete_list_of_spreadsheets = Panel(spreadsheetlist_2)

# ----
# CREATE NEW SPREADSHEET
# This component lets you set up a new blank spreadsheet from scratch. Hit the "create spreadsheet" button to activate.
pan = Panel("GH_Leafcutter Test")
pan_2 = Panel("""Worksheet 1
Worksheet 2
Worksheet 3""")
create_spreadsheet = Button()
overwrite = BooleanToggle(True)
createspreadsheet = CreateNewSpreadsheet(Token=gauth, Name=pan, Overwrite=overwrite, Worksheets=pan_2, Run=create_spreadsheet)

# ----
# Select the spreadsheet you want to edit or read
number_slider = Slider(2, range=0..100)
item = ListItem(List=spreadsheetlist_2, Index=number_slider, Wrap=True)
panel = Panel(item)

# ----
# FIND CELL ADDRESS
# Find Cell Address makes it easy to write data to a labeled location in a spreadsheet. For example, you can search for a certain heading, specify a +1 row offset, and then easily use the Write Spreadsheet component to place data under that heading.
pan_3 = Panel("Example Spreadsheet Name")
pan_4 = Panel("""Example Heading 1
Example Heading 2""")
list = ValueList({"No Offset": 0, "+1 Row Offset": 1, "+1 Colum Offset": 2}, selected="+1 Row Offset")
findcell = FindCellAddress(Token=gauth, Name=pan_3, Data=pan_4, Offset=list)
series = Series(Start=0, Step=1, Count=10)
seq = Sequence(Count=10, CharPool="ABCDEFGHIJKLMNOPQRSTUVWXYZ", Format="{0}")
write_to_spreadsheet = BooleanToggle(False)
entwine = Entwine(Branch00=seq, Branch01=series)
writespreadsheet = WriteToSpreadsheet(
    Token=gauth,
    Name=pan_3,
    OrganizeByRowsOrColumns=False,
    Address=graft(findcell),
    Data=entwine,
    Write=write_to_spreadsheet,
    createNewSpreadsheets=False)

# ----
# WRITE TO SPREADSHEET
# You can write to spreadsheet in a number of ways. In the first example, there is one cell address per data item, so you control the location of every piece of data individually. Enable the "write data" toggle to make the changes. If you haven't already created a spreadsheet with the specified name, an error will be thrown.
# Note that in the component is a menu item which allows you to tell it to create a spreadsheet if one with the specified name doesn't currently exist.
addresses = Panel("""A1
A2
A3
B1
B2
B3""")
write_data = BooleanToggle(False)
data = Panel("""Red
Green
Blue
Rouge
Vert
Bleu""")
writespreadsheet_2 = WriteToSpreadsheet(
    Token=gauth,
    Name=createspreadsheet,
    Worksheet="Worksheet 1",
    OrganizeByRowsOrColumns=True,
    Address=addresses,
    Data=data,
    Write=write_data,
    createNewSpreadsheets=False)

# ----
# READ FROM SPREADSHEET
# With only a token and spreadsheet name provided, the default settings for "Read from Spreadsheet" return the data, organized into branches by column.
# Customizing the input options, you can have the component return only a specified range, have it return nulls where there are empty cells, organize the data by row, and even return formulas instead of calculated cell values.
toggle = BooleanToggle(True)
refresh = Button()
readspreadsheet = ReadFromSpreadsheet(
    Token=gauth,
    Name=panel,
    IncludeBlankCells=False,
    OrganizeByRowsOrColumns=False,
    ReadFormulasOrValues=False,
    Refresh=True)  # -> Values, CellAddresses, SheetInfo
readspreadsheet_2 = ReadFromSpreadsheet(
    Token=gauth,
    Name=panel,
    IncludeBlankCells=toggle,
    SpreadsheetRange="A1 to C10",
    OrganizeByRowsOrColumns=Toggle(True),
    ReadFormulasOrValues=Toggle(True),
    Refresh=refresh)  # -> Values, CellAddresses, SheetInfo
panel_2 = Panel(readspreadsheet.Values)
panel_3 = Panel(readspreadsheet_2.Values)

# ----
# In the second example, multiple lists of data are provided in a tree, and a single address is provided as the starting address of each list. The component automatically moves to the next address for each subsequent piece of data, with the direction determined by the "Rows/Columns" toggle.
data_2 = Panel("""Green
Lettuce
Asparagus
Spinach
Peas""")
data_3 = Panel("""Red
Apple
Strawberry
Tomato""")
data_4 = Panel("""Blue
Blue Raspberry
Blueberry""")
addresses_2 = Panel("""A1
A2
A3""")
write_data_2 = BooleanToggle(False)
entwine_2 = Entwine(Branch00=data_3, Branch01=data_2, Branch02=data_4)
writespreadsheet_3 = WriteToSpreadsheet(
    Token=gauth,
    Name=createspreadsheet,
    Worksheet="Worksheet 2",
    OrganizeByRowsOrColumns=Toggle(True),
    Address=graft(addresses_2),
    Data=entwine_2,
    Write=write_data_2,
    createNewSpreadsheets=False)

# ----
# In the third example, a single address is provided, and the component automatically arranges the data into rows and columns, starting at the specified address.
number_slider_2 = Slider(4, range=0..100)
range = Range(Domain=Domain(0, 1), Steps=number_slider_2)  # -> graft(Range)
range_2 = Range(Domain=Domain(0, 1), Steps=Slider(5, range=0..100))
long = LongestList(ListA=range, ListB=range_2, PaddingMode=2)  # -> ListA, ListB
write_data_3 = BooleanToggle(False)
eval = Evaluate(F="sin(x+y)", x=long.ListA, y=long.ListB)
writespreadsheet_4 = WriteToSpreadsheet(
    Token=gauth,
    Name=createspreadsheet,
    Worksheet="Worksheet 3",
    OrganizeByRowsOrColumns=False,
    Address="A1",
    Data=eval,
    Write=write_data_3,
    createNewSpreadsheets=False)
